% Simulink data dictionary RL_data.sldd

reward_Cdist = 4
reward_Crate = 2
reward_Cact_d = 1
reward_Cy = 1
reward_Cyaw = 10
initialAngle_deg = Simulink.Parameter(0, Unit="deg")
reward_Rfail = 10
reward_Ck = 10
reward_Csteer_d = 20
reward_Rsuccess = 20
reward_Calive = 2